# Grasshopper definition Voorbeeld 11 - Stepping Stones.gh (Grasshopper 1.0.7)

# ---- group: Input
crv_blokken = Curve([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])
dom = ConstructDomain(DomainStart=Slider(10, range=0..100), DomainEnd=Slider(0, range=0..100))
crv_pad = Curve(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)

# ----
crv_blokken_2 = Curve(crv_blokken)
lng = ListLength(List=crv_blokken_2)
num = Number(dom)
aantal_tredes = Number(lng)
abs = Absolute(Value=num)
division = Division(A=abs, B=aantal_tredes)
range = Range(Domain=dom, Steps=aantal_tredes)
num_2 = Number(division)

crv_blokken_3 = Curve(crv_blokken)
crv_pad_2 = Curve(crv_pad)
ccx = CurveCurve(CurveA=crv_blokken_3, CurveB=crv_pad_2)  # -> Points, ParamsA, ParamsB
item = ListItem(List=ccx.ParamsB, Index=0, Wrap=True)  # -> Item, Item1
max = Maximum(A=item.Item, B=item.Item1)  # -> flatten(Result)
sort = SortList(Keys=max, ValuesA=crv_blokken_3)  # -> Keys, ValuesA
srf = Surface(sort.ValuesA)
Z = UnitZ(Factor=range)
extr = Extrude(Base=srf, Direction=Z)

Z_2 = UnitZ(Factor=range)
srf_2 = Surface(sort.ValuesA)
move = Move(Geometry=srf_2, Motion=Z_2)  # -> Geometry, Transform
srf_3 = Surface(move.Geometry)
srf_4 = Surface(srf_2)
entwine = Entwine(Branch00=srf_4, Branch01=srf_3, FlattenInputs=True)
flip = FlipMatrix(Data=entwine)

# ---- group: OUTPUT
num_3 = Number(num_2)
geo = Geometry(extr)
aantrede = Panel(num_3)
