# Grasshopper definition Voorbeeld 13 - Advanced Tree Manipulation.gh (Grasshopper 1.0.7)

recgrid = Rectangular(Plane=PlaneXY(0, 0, 0), SizeX=1, SizeY=2, ExtentX=10, ExtentY=5)  # -> Cells, Points
pt = Point(recgrid.Points)

flip = FlipMatrix(Data=pt)
pt_2 = Point(pt)
lng = ListLength(List=pt_2)  # -> expr("x-1", Length)
lng_2 = ListLength(List=flip)  # -> expr("x-1", Length)
item = ListItem(List=flatten(lng), Index=0, Wrap=True)
item_2 = ListItem(List=flatten(lng_2), Index=0, Wrap=True)
pt_3 = Point(pt_2)
entwine = Entwine(Branch00="0", Branch01=item, FlattenInputs=True)  # -> flatten(Result)
entwine_2 = Entwine(Branch00="0", Branch01=item_2, FlattenInputs=True)  # -> flatten(Result)
cull_i = CullIndex(List=pt_3, Indices=entwine, Wrap=False)
flip_2 = FlipMatrix(Data=cull_i)
cull_i_2 = CullIndex(List=flip_2, Indices=entwine_2, Wrap=False)

geo = Geometry(cull_i_2)
