# Grasshopper definition Voorbeeld 14 - Constructie.gh (Grasshopper 1.0.7)

crv = Curve(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)
crv_2 = Curve(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)
crv_3 = Curve(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)
crv_4 = Curve(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)
entwine = Entwine(Branch00=crv, Branch01=crv_2, Branch02=crv_3, Branch03=crv_4, FlattenInputs=True)  # -> flatten(Result)
hexgrid = Hexagonal(Plane=PlaneXY(0, 0, 0), Size=1, ExtentX=Slider(10, range=0..10), ExtentY=Slider(8, range=0..10))  # -> Cells, Points
crv_5 = Curve(flatten(hexgrid.Cells))
loft = Loft(Curves=entwine, Options={Adjust=False, Closed=False, LoftEnds=0, LoftSimp=0, LoftType=0, Rebuild=10, Refit=0.01})
Z = UnitZ(Factor=1)
project = Project(Curve=crv_5, Brep=loft, Direction=Z)
crv_6 = Curve(flatten([project, loft]))
disc = Discontinuity(Curve=crv_6, Level=1)  # -> Points, Parameters
shatter = Shatter(Curve=graft(crv_6), Parameters=disc.Parameters)
crv_7 = Curve(flatten(shatter))
detail = Slider(7, range=0..20)
pframes = PerpFrames(Curve=crv_7, Count=detail, Align=True)  # -> Frames, Parameters
rectangle = Rectangle(Plane=pframes.Frames, XSize=Slider(0.2, range=0..1), YSize=Slider(0.2, range=0..1), Radius=0)  # -> Rectangle, Length
cir = Circle(Plane=pframes.Frames, Radius=Slider(0.09, range=0..1))
crv_8 = Curve(rectangle.Rectangle)
lng = ListLength(List=cir)
subtraction = Subtraction(A=lng, B=1)
panel = Panel(cir)
loft_2 = Loft(Curves=cir, Options={Adjust=False, Closed=False, LoftEnds=0, LoftSimp=0, LoftType=0, Rebuild=10, Refit=0.01})
item = ListItem(List=cir, Index=0, Wrap=True)
item_2 = ListItem(List=cir, Index=subtraction, Wrap=True)
srf = Surface(item_2)
srf_2 = Surface(item)
brep = Brep([loft_2, srf_2, srf])
