# Grasshopper definition Voorbeeld 16 - Radial Walls.gh (Grasshopper 1.0.7)

vec = VectorXYZ(XComponent=Slider(100, range=0..100), YComponent=Slider(100, range=0..100), ZComponent=Slider(0, range=0..100))  # -> Vector, Length
num_aantal_vectoren = Number(Slider(100, range=0..100))
num_randomness = Number(Slider(100, range=0..100))
num_seed = Number(Slider(54, range=0..100))
pt = Point("0,0,0")
vec_base = Vector(vec.Vector)

num = Number(Slider(18, range=0..100))

multiplication = Multiplication(A=num_randomness, B=-1)
addition = Addition(A=num_seed, B=1)
dom = ConstructDomain(DomainStart=multiplication, DomainEnd=num_randomness)
addition_2 = Addition(A=num_seed, B=2)
devec = DeconstructVector(Vector=vec_base)  # -> XComponent, YComponent, ZComponent
random = Random(Range=dom, Number=num_aantal_vectoren, Seed=num_seed)
random_2 = Random(Range=dom, Number=num_aantal_vectoren, Seed=addition)
random_3 = Random(Range=dom, Number=num_aantal_vectoren, Seed=addition_2)
addition_3 = Addition(A=devec.XComponent, B=random)
addition_4 = Addition(A=devec.YComponent, B=random_2)
addition_5 = Addition(A=devec.ZComponent, B=random_3)
addition_6 = Addition(A=addition_5, B=num)
vec_2 = VectorXYZ(XComponent=addition_3, YComponent=addition_4, ZComponent=addition_6)  # -> Vector, Length
vec_3 = VectorXYZ(XComponent=addition_3, YComponent=addition_4, ZComponent=addition_5)  # -> Vector, Length
vec_onder = Vector(vec_3.Vector)
vec_boven = Vector(vec_2.Vector)

vdis = VectorDisplay(Anchor=pt, Vector=vec_base)

entwine = Entwine(
    Branch00=Slider(0.44, range=0..1),
    Branch01=Slider(0.59, range=0..1),
    Branch02=Slider(0.74, range=0..1),
    Branch03=Slider(0.84, range=0..1),
    FlattenInputs=True)  # -> flatten(Result)
entwine_2 = Entwine(Branch00=Slider(1, range=0..1), Branch01=Slider(3, range=0..10), FlattenInputs=True)  # -> flatten(Result)

pt_2 = Point(pt)

num_t_waardes = Number(entwine)
vec_boven_2 = Vector(vec_boven)
num_id = Number(entwine_2)
vec_onder_2 = Vector(vec_onder)
pt_3 = Point(pt_2)
vlen = VectorLength(Vector=vec_onder_2)
vlen_2 = VectorLength(Vector=vec_boven_2)
crv = Curve()
line = LineSDL(Start=pt_3, Direction=vec_onder_2, Length=vlen)
eval = EvaluateCurve(Curve=graft(line), Parameter=num_t_waardes)  # -> Point, Tangent, Angle
line_2 = LineSDL(Start=pt_3, Direction=vec_boven_2, Length=vlen_2)
shatter = Shatter(Curve=line, Parameters=num_t_waardes)
shatter_2 = Shatter(Curve=line_2, Parameters=num_t_waardes)
item = ListItem(List=shatter, Index=num_id, Wrap=True)
item_2 = ListItem(List=shatter_2, Index=num_id, Wrap=True)
entwine_3 = Entwine(Branch00=item, Branch01=item_2, FlattenInputs=True)
flip = FlipMatrix(Data=entwine_3)
loft = Loft(Curves=flip, Options={Adjust=False, Closed=False, LoftEnds=0, LoftSimp=0, LoftType=0, Rebuild=10, Refit=0.01})
