# Grasshopper definition Voorbeeld 17 - Koepel.gh (Grasshopper 1.0.7)

pt = Point(Point(0, 0, 0))

# ---- group: INPUT
number_slider = Slider(100, range=0..100)
xy = XYPlane(Origin=Point(0, 0, 0))
planesrf = PlaneSurface(Plane=xy, XSize="-1000 to 1000", YSize="-1000 to 1000")
radius = Number(Slider(17, range=0..100))
count = Number(Slider(7, range=0..10))
srf = Surface(planesrf)
num = Number(Slider(15, range=0..100))

# ----
pt_2 = Point(pt)
series = Series(Start=radius, Step=radius, Count=count)
sph = Sphere(Base=pt, Radius=number_slider)
cir = Circle(Plane=pt_2, Radius=series)
split = SplitBrep(Brep=sph, Cutter=srf)
item = ListItem(List=split, Index=0, Wrap=True)
lng = ListLength(List=cir)
crv = Curve(cir)
brep = Brep(item)
item_2 = ListItem(List=cir, Index=expr("x-1", lng), Wrap=True)
item_3 = ListItem(List=cir, Index=0, Wrap=True)
project = Project(Curve=crv, Brep=brep, Direction=Vector(0, 0, 1))  # -> flatten(Curve)
divide = DivideCurve(Curve=item_3, Count=num, Kinks=False)  # -> Points, Tangents, Parameters
divide_2 = DivideCurve(Curve=item_2, Count=num, Kinks=False)  # -> Points, Tangents, Parameters
crv_circle = Curve(project)
ln = Line(StartPoint=divide.Points, EndPoint=divide_2.Points)
crv_2 = Curve(ln)
project_2 = Project(Curve=crv_2, Brep=brep, Direction=Vector(0, 0, 1))  # -> flatten(Curve)
crv_radial = Curve(project_2)

h = Number(Slider(2, range=0..100))
b = Number(Slider(2, range=0..100))
crv_circle_2 = Curve(crv_circle)
offset = OffsetCurve(Curve=crv_circle_2, Distance=b, Plane=PlaneXY(0, 0, 0), Corners=1)  # -> flatten(Curve)
entwine = Entwine(Branch00=crv_circle_2, Branch01=offset, FlattenInputs=True)
flip = FlipMatrix(Data=entwine)
Z = UnitZ(Factor=h)
boundary = BoundarySurfaces(Edges=flip)
extr = Extrude(Base=boundary, Direction=Z)  # -> flatten(Extrusion)

crv_radial_2 = Curve(crv_radial)
h_2 = Number(Slider(0.62, range=0..1))
b_2 = Number(Slider(0.69, range=0..1))
crv_radial_3 = Curve(crv_radial_2)
dedomain = DeconstructDomain(Domain=crv_radial_3)  # -> Start, End
dom = ConstructDomain(DomainStart=expr("x*-1", b_2), DomainEnd=b_2)
pframe = PerpFrame(Curve=crv_radial_3, Parameter=dedomain.Start)
dom_2 = ConstructDomain(DomainStart=expr("x*-1", h_2), DomainEnd=h_2)
rectangle = Rectangle(Plane=pframe, XSize=dom_2, YSize=dom, Radius=0)  # -> Rectangle, Length
swp1 = Sweep1(Rail=graft(crv_radial_3), Sections=graft(rectangle.Rectangle), Miter=1)  # -> flatten(Brep)
geo = Geometry(swp1)

brep_2 = Brep(item)
entwine_2 = Entwine(Branch00=crv_radial_2, Branch01=crv_circle_2, FlattenInputs=True)  # -> flatten(Result)
srfsplit = SurfaceSplit(Surface=brep_2, Curves=entwine_2)
srf_2 = Surface(srfsplit)

geo_2 = Geometry(extr)
panel = Panel("""true
false""")

# ---- group: OUTPUT
geo_3 = Geometry(geo)
geo_4 = Geometry(geo_2)
srf_3 = Surface(srf_2)

# ----
bool = Boolean(panel)
dispatch = Dispatch(List=srf_3, DispatchPattern=bool)  # -> ListA, ListB
srf_4 = Surface(dispatch.ListA)
srf_5 = Surface(dispatch.ListB)
