# Grasshopper definition Voorbeeld 18 -Point Randomness.gh (Grasshopper 1.0.7)

number_slider = Slider(17, range=0..1000)  # disabled
number_slider_2 = Slider(100, range=0..100)  # disabled
number_slider_3 = Slider(1000, range=0..1000)  # disabled

crv = Curve(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)
pt = Point(Point(-143.6250355, 133.6944131, 0))
num = Number(Slider(1000, range=0..1000))

number_slider_4 = Slider(1.1, range=0..10)  # disabled
crv_2 = Curve(crv)  # disabled
pt_2 = Point(<point referenced from the Rhino model>)  # disabled
num_2 = Number(number_slider_2)  # disabled

random = Random(Range=Domain(0, 1), Number=num, Seed=2)
pop2d = Populate2D(Region=crv, Count=num, Seed=1)
dist = Distance(PointA=pt, PointB=pop2d)
bnd = Bounds(Numbers=dist)
remap = RemapNumbers(Value=dist, Source=bnd, Target=Domain(0, 1))  # -> Mapped, Clipped
graph = GraphMapper(
    remap.Mapped,
    x0=0,
    x1=1,
    y0=0,
    y1=1,
    container_name="Bezier",
    cpx=[0, 0.1741372794, 0.245340541, 1],
    cpy=[0, 0, 0.7822598815, 1])
smaller = SmallerThan(FirstNumber=graph, SecondNumber=random)  # -> SmallerThan, OrEqualTo
bool = Boolean(smaller.OrEqualTo)
dispatch = Dispatch(List=pop2d, DispatchPattern=bool)  # -> ListA, ListB
pt_3 = Point(dispatch.ListA)

pop2d_2 = Populate2D(Region=crv_2, Count=num_2, Seed=1)  # disabled
pcharge = PointCharge(Point=pt_2, Charge=number_slider, Decay=number_slider_4, Bounds=crv_2)  # disabled
evf = EvaluateField(Field=pcharge, Point=pop2d_2)  # -> Tensor, Strength; disabled
number_slider_5 = Slider(534, range=0..1000)  # disabled
multiplication = Multiplication(A=evf.Tensor, B=number_slider_5)  # disabled
move = Move(Geometry=pop2d_2, Motion=multiplication)  # -> Geometry, Transform; disabled
ln = Line(StartPoint=pop2d_2, EndPoint=move.Geometry)  # disabled
pt_4 = Point(pt_3)
voronoi = Voronoi(Points=pt_4, Boundary=crv, BruteForceOverride=False)
