# Grasshopper definition Voorbeeld 19 - Path out of Sphere.gh (Grasshopper 1.0.7)

number_slider = Slider(2398, range=0..10000)
number_slider_2 = Slider(660, range=0..1000)
Z = UnitZ(Factor=number_slider_2)  # -> expr("-x", UnitVector)
dom = ConstructDomain(DomainStart=expr("-x", number_slider), DomainEnd=number_slider)
xy = XYPlane(Origin=Point(0, 0, 0))
sph = Sphere(Base=PlaneXY(0, 0, 0), Radius=Slider(1000, range=0..1000))
planesrf = PlaneSurface(Plane=xy, XSize=dom, YSize=dom)
move = Move(Geometry=planesrf, Motion=Z)  # -> Geometry, Transform
split = SplitBrep(Brep=sph, Cutter=planesrf)
item = ListItem(List=split, Index=1, Wrap=True)
split_2 = SplitBrep(Brep=item, Cutter=move.Geometry)
item_2 = ListItem(List=split_2, Index=0, Wrap=True)
geo = Geometry(item_2)

edges = BrepEdges(Brep=geo)  # -> Naked, Interior, NonManifold
srf = Surface(geo)
crv = Curve(edges.Naked)
geo_2 = Geometry(geo)
item_3 = ListItem(List=crv, Index=0, Wrap=True)
divdist = DivideDistance(Curve=item_3, Distance=Slider(100, range=0..1000))  # -> Points, Tangents, Parameters
lng = ListLength(List=divdist.Points)
range = Range(Domain=number_slider_2, Steps=expr("x-1", lng))
Z_2 = UnitZ(Factor=expr("-x", range))
move_2 = Move(Geometry=divdist.Points, Motion=Z_2)  # -> Geometry, Transform
pdecon = Deconstruct(Point=move_2.Geometry)  # -> XComponent, YComponent, ZComponent
pt = ConstructPoint(XCoordinate=0, YCoordinate=0, ZCoordinate=pdecon.ZComponent)
vec2pt = Vector2Pt(PointA=move_2.Geometry, PointB=pt, Unitize=False)  # -> Vector, Length
srf_2 = Surface(srf)
project = ProjectPoint(Point=move_2.Geometry, Direction=vec2pt.Vector, Geometry=srf_2)  # -> Point, Index
amp = Amplitude(Vector=vec2pt.Vector, Amplitude=Slider(65, range=0..100))
intcrv = Interpolate(Vertices=project.Point, Degree=3, Periodic=False, KnotStyle=0)  # -> Curve, Length, Domain
move_3 = Move(Geometry=project.Point, Motion=amp)  # -> Geometry, Transform
intcrv_2 = Interpolate(Vertices=move_3.Geometry, Degree=3, Periodic=False, KnotStyle=0)  # -> Curve, Length, Domain
loft = Loft(
    Curves=[intcrv_2.Curve, intcrv.Curve],
    Options={Adjust=False, Closed=False, LoftEnds=0, LoftSimp=0, LoftType=0, Rebuild=10, Refit=0.01})
