# Grasshopper definition Voorbeeld 2 - Triangulation & Scale based on Distance.gh (Grasshopper 1.0.7)

# ---- group: input
crv = Curve(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)
de_bak = Rectangle({Plane=PlaneXY(-72.00932066, -20.25544686, 0), Size=Domain2(u=-60.92453045..60.92453045, v=-116.0818571..116.0818571)})
number_of_points = Number(Slider(114, range=0..1000))
upper_bound_scale = Number(Slider(30, range=0..100))
lower_bound_scale = Number(Slider(0, range=0..100))
de_route = Curve(crv)

# ---- group: 1 | Get Random Points, and Group them per triangle
pop2d = Populate2D(Region=de_bak, Count=number_of_points, Seed=1)
del = DelaunayMesh(Points=pop2d, Plane=PlaneXY(0, 0, 0))
demesh = DeconstructMesh(Mesh=del)  # -> Vertices, Faces, Colours, Normals
deface = DeconstructFace(Face=demesh.Faces)  # -> CornerA, CornerB, CornerC, CornerD
entwine = Entwine(Branch00=deface.CornerA, Branch01=deface.CornerB, Branch02=deface.CornerC, FlattenInputs=True)
item = ListItem(List=demesh.Vertices, Index=entwine, Wrap=True)
flip = FlipMatrix(Data=item)
three_points_per_triangle = Point(flip)

# ---- group: 2 | Make Triangles
three_points_per_triangle_2 = Point(three_points_per_triangle)
item_2 = ListItem(List=three_points_per_triangle_2, Index=0, Wrap=True)  # -> Item, Item1, Item2
avr = Average(Input=three_points_per_triangle_2)  # -> flatten(ArithmeticMean)
srf4pt = _4PointSurface(CornerA=item_2.Item, CornerB=item_2.Item1, CornerC=item_2.Item2)  # -> flatten(Surface)
triangle_middlepoints = Point(avr)
triangle_surfaces = Surface(srf4pt)

# ----
# Author: Jos Feenstra
# Version: 27 / 09 / 2019
upper_bound_scale_2 = Number(lower_bound_scale)
num = Number(upper_bound_scale)

# ---- group: 3 | Get Scale Factors based upon Distance From Route
de_route_2 = Curve(de_route)
triangle_middlepoints_2 = Point(triangle_middlepoints)
crv_cp = CurveClosestPoint(Point=triangle_middlepoints_2, Curve=de_route_2)  # -> Point, Parameter, Distance
num_2 = Number(crv_cp.Distance)
dom = ConstructDomain(DomainStart=upper_bound_scale_2, DomainEnd=num)
remap = RemapNumbers(Value=num_2, Source=dom, Target="0 to 1")  # -> Mapped, Clipped
scale_factors = Number(remap.Clipped)

# ----
triangle_middlepoints_3 = Point(triangle_middlepoints)
triangle_surfaces_2 = Surface(triangle_surfaces)
scale_factors_2 = Number(scale_factors)
scale = Scale(Geometry=triangle_surfaces_2, Center=triangle_middlepoints_3, Factor=scale_factors_2)  # -> Geometry, Transform
scaled_triangles = Surface(scale.Geometry)

# ---- group: Output
scaled_triangles_2 = Surface(scaled_triangles)
