# Grasshopper definition Voorbeeld 3 - Trap.gh (Grasshopper 1.0.7)

# ---- group: Input
crv_rail_rechts = Curve(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)
curve_boven = Curve(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)
curve_onder = Curve(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)
crv_rail_links = Curve(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)
n_tredes = Number(Slider(13, range=0..100))
hoogte = Number(Slider(20, range=0..100))

# ----
edgesrf = EdgeSurface(CurveA=curve_boven, CurveB=curve_onder, CurveC=crv_rail_links, CurveD=crv_rail_rechts)
range = Range(Domain=Domain(0, 1), Steps=n_tredes)
srf = Surface(reparameterize(edgesrf))
pt = ConstructPoint(XCoordinate=range, YCoordinate=0, ZCoordinate=0)
iso = IsoCurve(Surface=srf, UVPoint=pt)  # -> flatten(UIsocurve), flatten(VIsocurve)
trap_curves = Curve(iso.VIsocurve)

# ----
# Author: Jos Feenstra
# Version: 27 / 09 / 2019
trap_curves_2 = Curve(trap_curves)
n_tredes_2 = Number(n_tredes)
hoogte_2 = Number(hoogte)
dom = ConstructDomain(DomainStart=0, DomainEnd=hoogte_2)
dom_2 = ConstructDomain(DomainStart=0, DomainEnd=n_tredes_2)
range_2 = Range(Domain=dom, Steps=n_tredes_2)
range_3 = Range(Domain=dom_2, Steps=n_tredes_2)
addition = Addition(A=range_3, B=1)
dom_3 = ConstructDomain(DomainStart=range_3, DomainEnd=addition)
Z = UnitZ(Factor=range_2)
subset = SubList(List=trap_curves_2, Domain=dom_3, Wrap=False)  # -> List, Index
loft = Loft(Curves=subset.List, Options={Adjust=False, Closed=False, LoftEnds=0, LoftSimp=0, LoftType=0, Rebuild=10, Refit=0.01})
move = Move(Geometry=loft, Motion=graft(Z))  # -> Geometry, Transform
merge = Merge(Data1=loft, Data2=move.Geometry)
loft_2 = Loft(Curves=merge, Options={Adjust=False, Closed=False, LoftEnds=0, LoftSimp=0, LoftType=0, Rebuild=10, Refit=0.01})
geo = Geometry(loft_2)

# ---- group: Output
geo_2 = Geometry(geo)
geo_3 = Geometry(loft)
geo_4 = Geometry(move.Geometry)
join = BrepJoin(Breps=flatten([geo_2, geo_4, geo_3]))  # -> Breps, Closed
geo_5 = Geometry(join.Breps)
