# Grasshopper definition Voorbeeld 4 - Pad.gh (Grasshopper 1.0.7)

# ---- group: Input
number_slider = Slider(20, range=0..100)
crv_cross_section = Curve([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])
crv_paaltjes = Curve(graft([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]))
crv_rail = Curve(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)

# ---- group: Process
# Author: Jos Feenstra
# Version: 27 / 09 / 2019
Y = UnitY(Factor=1)
extr = Extrude(Base=crv_paaltjes, Direction=Y)
swp1 = Sweep1(Rail=crv_rail, Sections=graft(crv_cross_section), Miter=0)
divdist = DivideDistance(Curve=crv_rail, Distance=number_slider)  # -> Points, Tangents, Parameters
Z = UnitZ(Factor=1)
cap = CapHoles(Brep=extr)
pl = ConstructPlane(Origin=divdist.Points, XAxis=divdist.Tangents, YAxis=Z)
item = ListItem(List=pl, Index=0, Wrap=True)
orient = Orient(Geometry=cap, Source=item, Target=pl)  # -> Geometry, Transform

# ---- group: Output
geo = Geometry(swp1)
geo_2 = Geometry(orient.Geometry)
