# Grasshopper definition Voorbeeld 6 - Lotus.gh (Grasshopper 1.0.7)

# ---- group: Input
height_pedals = Slider(741, range=0..10000)
radius_pedals = Slider(10000, range=0..10000)
number_slider = Slider(400, range=0..1000)
crv_basis = Curve(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)
area = Area(Geometry=crv_basis)  # -> Area, Centroid
pt_echte_midden = Point(area.Centroid)

# ----
pt_midden = Point(Point(-148516.4561, 260281.2916, -34148.38287))

# ---- group: Process
# Author: Jos Feenstra
# Version: 27 / 09 / 2019
pop3d = Populate3D(Region=crv_basis, Count=number_slider, Seed=1)
arc = Arc(Plane=PlaneXY(0, 0, 0), Radius=radius_pedals, Angle=Domain(0, 3.141592654))  # -> Arc, Length
Z = UnitZ(Factor=height_pedals)
end = EndPoints(Curve=arc.Arc)  # -> Start, End
pt_midden_2 = Point(pt_midden)
ln = Line(StartPoint=end.Start, EndPoint=end.End)
join = JoinCurves(Curves=flatten([arc.Arc, ln]), Preserve=False)
Z_2 = UnitZ(Factor=1)
yz = YZPlane(Origin=Point(0, 0, 0))
srf = Surface(join)

# ----
incurve = PointInCurve(Point=pop3d, Curve=crv_basis)  # -> Relationship, Point
c_script = CSharpScript(x=pop3d, y=incurve.Relationship)  # -> out, A; inputs x: Point3d, y: Int32
# ---------- c_script: C# ----------
    if (y != 0) A = x;
# ---------- end c_script ----------
extr = Extrude(Base=srf, Direction=Z)

# ---- group: Process (continued)
pt_random = Point(c_script.A)
vec2pt = Vector2Pt(PointA=pt_midden_2, PointB=pt_random, Unitize=False)  # -> Vector, Length
pl = ConstructPlane(Origin=pt_random, XAxis=vec2pt.Vector, YAxis=Z_2)
orient = Orient(Geometry=srf, Source=yz, Target=pl)  # -> Geometry, Transform

# ---- group: Output
geo = Geometry(orient.Geometry)
