# Grasshopper definition Voorbeeld 7 - Hexagon Field.gh (Grasshopper 1.0.7)

# ---- group: Input
number_slider = Slider(200, range=0..1000)
number_slider_2 = Slider(0, range=0..100)
number_slider_3 = Slider(50, range=0..100)
number_slider_4 = Slider(20, range=0..100)
number_slider_5 = Slider(50, range=0..100)
crv = Curve(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)

# ---- group: Process
# Author: Jos Feenstra
# Version: 27 / 09 / 2019
hexgrid = Hexagonal(Plane=PlaneXY(0, 0, 0), Size=number_slider_5, ExtentX=number_slider_4, ExtentY=number_slider_4)  # -> Cells, Points
dom = ConstructDomain(DomainStart=number_slider, DomainEnd=number_slider_2)
crv_2 = Curve(flatten(hexgrid.Cells))
lng = ListLength(List=crv_2)
random = Random(Range=number_slider_3, Number=lng, Seed=2)
end = EndPoints(Curve=crv_2)  # -> Start, End
crv_cp = CurveClosestPoint(Point=end.End, Curve=crv)  # -> Point, Parameter, Distance
bnd = Bounds(Numbers=crv_cp.Distance)

# ---- group: Input (continued)
remap = RemapNumbers(Value=crv_cp.Distance, Source=bnd, Target=Domain(0, 1))  # -> Mapped, Clipped
graph = GraphMapper(
    remap.Mapped,
    x0=0,
    x1=1,
    y0=0,
    y1=1,
    container_name="Bezier",
    cpx=[0, 0.4428031147, 0, 1],
    cpy=[0, 0.5956522226, 0.9956401587, 1])
remap_2 = RemapNumbers(Value=graph, Source=Domain(0, 1), Target=bnd)  # -> Mapped, Clipped

# ---- group: Process (continued)
remap_3 = RemapNumbers(Value=remap_2.Mapped, Source=bnd, Target=dom)  # -> Mapped, Clipped
addition = Addition(A=random, B=remap_3.Mapped)
Z = UnitZ(Factor=addition)
extr = Extrude(Base=crv_2, Direction=Z)
cap = CapHoles(Brep=extr)

# ---- group: Output
geo = Geometry(cap)
